# Dynamo graph Home.dyn (Dynamo 2.13.1.3887)

current = Document.Current()
python_script = Python(IN[0]=current)  # CPython3; graph output
# ---------- python_script.python (63 lines) ----------
import csv
import clr
clr.AddReference('RevitAPI')
from Autodesk.Revit.DB import *

# Substitua 'Caminho/Para/Seu/Arquivo.csv' pelo caminho do seu arquivo CSV
csvFilePath = r'C:\\Users\\FD PROJETOS2\\Desktop\\_\\tiago_lima\\revit\\file.csv'

# Substitua 'NomeDaFamília' e 'TipoDaFamília' pelos valores apropriados para a sua família de detalhe
familyName = 'Painel'
typeName = 'Painel'

# Função para encontrar uma família e tipo no documento atual
def find_family_and_type(doc, family_name, type_name):
    fam_symbol = None
    for fam in FilteredElementCollector(doc).OfClass(Family):
        if fam.Name == family_name:
            for symbolId in fam.GetFamilySymbolIds():
                symbol = doc.GetElement(symbolId)
                if symbol.Name == type_name:
                    fam_symbol = symbol
                    break
    return fam_symbol

# Função para criar instâncias de família
def create_family_instances(doc, fam_symbol, locations):
    with Transaction(doc, 'Create Family Instances') as trans:
        trans.Start()
        if not fam_symbol.IsActive:
            fam_symbol.Activate()
            doc.Regenerate()
        for loc in locations:
            doc.Create.NewFamilyInstance(XYZ(loc[0], loc[1], 0), fam_symbol, doc.ActiveView)
        trans.Commit()

# Lendo o arquivo CSV e armazenando as posições das instâncias
locations = []
x_offset = 0
with open(csvFilePath, mode='r') as file:
    reader = csv.DictReader(file, delimiter=';')
    for row in reader:
        try:
            comprimento = float(row['Comprimento'].replace(',', '.'))
            largura = float(row['Largura'].replace(',', '.'))
            espessura = float(row['Espessura'].replace(',', '.'))
            quantidade = int(row['Quantidade'])
            
            # Calculando o deslocamento para cada instância
            for _ in range(quantidade):
                locations.append((x_offset, 0))
                x_offset += comprimento / 304.8  # Convertendo para pés
        except:
            OUT = row

# Encontrar a família e tipo no documento
doc = __revit__.ActiveUIDocument.Document
fam_symbol = find_family_and_type(doc, familyName, typeName)

# Criar instâncias da família na vista ativa
if fam_symbol:
    create_family_instances(doc, fam_symbol, locations)
else:
    TaskDialog.Show('Erro', 'Família ou tipo não encontrado.')
# ----------------------------------------
